# Grasshopper definition 3. Roughing.gh (Grasshopper 1.0.4)

panel = Panel("Roughing Pass 2")
bake_now = Button()
slice_offset = Panel("1/8")
output_layer = Panel("Roughing::Pass 2")
cache_name = Panel("Roughing 2")
pipeline = GeometryPipeline(
    GroupByLayer=False,
    GroupByType=False,
    IncludeHidden=True,
    IncludeLocked=True,
    LayerFilter="Mold::Roughing Surfaces",
    NameFilter="*",
    SublayerFiltering=True,
    TypeFilter=1073741848)
brep = Brep(graft(pipeline))
xz = XZPlane(Origin=Point(0, 0, 0))
Y = UnitY(Factor=1)
contour = Contour(Shape=brep, Point=xz, Direction=Y, Distance=slice_offset)
simplify = SimplifyTree(Tree=contour, Front=False)
trim = TrimTree(Tree=simplify, Depth=2)
path_mapper = PathMapper(trim, source="{A}", target="{A;0}")
panel_2 = Panel(path_mapper)
c_script = CSharpScript(BakeNow=bake_now, Geometry=path_mapper, Layer=output_layer, CacheName=cache_name)  # -> out, A; inputs BakeNow: Boolean, Geometry: tree, Layer: String, CacheName: String
# ---------- c_script: C# ----------
    if (!BakeNow)
      return;

    var doc = Rhino.RhinoDoc.ActiveDoc;
    var result = new System.Text.StringBuilder();
    int layerIndex = 0;
    if (Layer == null)
      layerIndex = doc.Layers.CurrentLayerIndex;
    else
      layerIndex = doc.Layers.FindByFullPath(Layer, 0);
    var key = string.Format("Cache({0})", CacheName);

    // Delete existing cache data
    var existing = doc.Objects.FindByUserString(key, "*", false);
    foreach(RhinoObject obj in existing)
    {
      if (obj.Attributes.LayerIndex == layerIndex)
      {
        doc.Objects.Delete(obj, true);
      }
    }



    // Save geometry to model
    for (int i = 0; i < Geometry.Branches.Count; i++)
    {
      var path = Geometry.Paths[i];
      for (int g = 0; g < Geometry.Branches[i].Count; g++)
      {
        var geo = Geometry.Branches[i][g];
        var attr = new Rhino.DocObjects.ObjectAttributes();
        var cacheValue = string.Format("{0}({1})", path, g);
        attr.SetUserString(key, cacheValue);
        attr.LayerIndex = layerIndex;
        result.Append(cacheValue).Append("\r\n");
        result.Append(geo.GetType()).Append("\r\n");
        if (geo is Rhino.Geometry.Line)
          doc.Objects.AddLine((Rhino.Geometry.Line) geo, attr);
        else
          doc.Objects.Add((Rhino.Geometry.GeometryBase) geo, attr);
      }
    }
    A = result;
# ---------- end c_script ----------
